# Grasshopper definition Sapata_Lisa_Quadrada-com haste.gh (Grasshopper 1.0.7)

# ---- group: Quadrado com haste
number_slider = Slider(2, range=0..10)
division = Division(A=Slider(22, range=0..100), B=2)
division_2 = Division(A=Slider(19, range=0..100), B=2)
dom = ConstructDomain(DomainStart=division, DomainEnd=expr("-x", division))
dom_2 = ConstructDomain(DomainStart=division_2, DomainEnd=expr("-x", division_2))
rectangle = Rectangle(Plane=PlaneXY(0, 0, 0), XSize=dom, YSize=dom_2, Radius=0)  # -> Rectangle, Length
boxrec = BoxRectangle(Rectangle=rectangle.Rectangle, Height=number_slider)
addition = Addition(A=number_slider, B=Slider(15, range=0..100))
division_3 = Division(A=number_slider, B=2)
panel = Panel("""0
1
2
3
8
9
10
11""")
cyl = Cylinder(Base=PlaneXY(0, 0, 0), Radius=expr("x/2", Slider(5, range=0..10)), Length=addition)
filedge = FilletEdge(Shape=boxrec, Blend=0, Metric=0, Edges=panel, Radii=division_3)
sunion = SolidUnion(Breps=[filedge, cyl])
