# Grasshopper definition Sapata_Lisa_Quadrada.gh (Grasshopper 1.0.7)

# ---- group: Sapata Lisa Quadrada
division = Division(A=Slider(22, range=0..100), B=2)
division_2 = Division(A=Slider(19, range=0..100), B=2)
dom = ConstructDomain(DomainStart=division, DomainEnd=expr("-x", division))
dom_2 = ConstructDomain(DomainStart=division_2, DomainEnd=expr("-x", division_2))
rectangle = Rectangle(Plane=PlaneXY(0, 0, 0), XSize=dom, YSize=dom_2, Radius=0)  # -> Rectangle, Length
number_slider = Slider(2, range=0..10)
boxrec = BoxRectangle(Rectangle=rectangle.Rectangle, Height=number_slider)
division_3 = Division(A=number_slider, B=2)
panel = Panel("""0
1
2
3
8
9
10
11""")
filedge = FilletEdge(Shape=boxrec, Blend=0, Metric=0, Edges=panel, Radii=division_3)
