# Grasshopper definition Sapata_Lisa_Redonda-com Haste.gh (Grasshopper 1.0.7)

number_slider = Slider(3, range=0..10)
cyl = Cylinder(Base=PlaneXY(0, 0, 0), Radius=expr("x/2", Slider(24, range=0..100)), Length=number_slider)
addition = Addition(A=number_slider, B=Slider(15, range=0..100))
cyl_2 = Cylinder(Base=PlaneXY(0, 0, 0), Radius=expr("x/2", Slider(5, range=0..100)), Length=addition)
cap = CapHoles(Brep=cyl)
filedge = FilletEdge(Shape=cap, Blend=0, Metric=0, Edges="0", Radii=number_slider)
sunion = SolidUnion(Breps=[filedge, cyl_2])
