# Grasshopper definition Sapata_Lisa_Redonda.gh (Grasshopper 1.0.7)

# ---- group: Redondo sem Haste
number_slider = Slider(3, range=0..10)
cyl = Cylinder(Base=PlaneXY(0, 0, 0), Radius=expr("x/2", Slider(28, range=0..100)), Length=number_slider)
cap = CapHoles(Brep=cyl)
filedge = FilletEdge(Shape=cap, Blend=0, Metric=0, Edges="0", Radii=number_slider)
